vi "Init.gvi"   [LabVIEW NXG 3.0.0]
# This VI creates a dam based on it’s last logged state in the input log path.
inputs:
  "Log Path": path
  "Error in": error
outputs:
  "Dam out": "Dam.gtype"
  "Error out": error
types:
  "Lake properties.gtype" = cluster{"Lake Fill (Acre-feet)": f64, "Lake Intake Rate (cfs)": f64, "Lake Discharge Rate (cfs)": f64}
  "Large Floodgates properties.gtype" = cluster{"# of Large Floodgates": i32, "Large Flodgates Size (cfs)": f64, "Large Floodgates Status": bool[]}
  "Small Floodgates properties.gtype" = cluster{"# of Small Floodgates": i32, "Small Floodgates Size (cfs)": f64, "Small Floodgates Status": bool[]}
  "Turbines properties.gtype" = cluster{"# of Turbines": i32, "Power at Max Flow (MW)": f64, "Turbine Gates Status": bool[], "Turbines State (%)": f64[], "Total Power Being Generated (MW)": f64}
  "Report Data.gtype" = cluster{"Lake properties": "Lake properties.gtype", "Large Floodgates properties": "Large Floodgates properties.gtype", "Small Floodgates properties": "Small Floodgates properties.gtype", "Turbines properties": "Turbines properties.gtype"}
uses:
  Lake.gtype::Init.gvi
  Floodgate.gtype::Init.gvi
  Turbine.gtype::Init.gvi
  Report.gtype::Open or Create.gvi
diagram:
  w1 = "Report Data.gtype" {"Lake properties"={"Lake Fill (Acre-feet)"=0, "Lake Intake Rate (cfs)"=0, "Lake Discharge Rate (cfs)"=0}, "Large Floodgates properties"={"# of Large Floodgates"=4, "Large Flodgates Size (cfs)"=0, "Large Floodgates Status"=[]}, "Small Floodgates properties"={"# of Small Floodgates"=5, "Small Floodgates Size (cfs)"=0, "Small Floodgates Status"=[]}, "Turbines properties"={"# of Turbines"=2, "Power at Max Flow (MW)"=0, "Turbine Gates Status"=[], "Turbines State (%)"=[], "Total Power Being Generated (MW)"=0}}
  case ($"Error in") {
    frame No Error {
      Property Node(instance in=w1) -> ("Lake properties"=w4, "Large Floodgates properties"=w5, "Small Floodgates properties"=w6, "Turbines properties"=w7)
      Property Node(instance in=w4) -> ("Lake Fill (Acre-feet)"=w8, "Lake Intake Rate (cfs)"=w9, "Lake Discharge Rate (cfs)"=w10)
      call "Init.gvi"(Fill (Acre-feet)=w8, Intake Rate (cfs)=w9, Discharge Rate (cfs)=w10, Error in=$"Error in") -> (Lake out=w11, Error out=w12)
      Property Node(instance in=w5) -> ("# of Large Floodgates"=w13, "Large Flodgates Size (cfs)"=w14, "Large Floodgates Status"=w15)
      s1 = $"Error in"  # shift register
      for (N = w13) (iteration -> i1) {
        Array Index(array=w15) -> (out0[i1]=w17)
        call "Init.gvi"(Size (cfs)=w14, State (FALSE = Closed)=w17, Error in=s1) -> (Floodgate out=w18, Error out=w19)
        append w18 to w16
        next s1 = w19
      }
      Property Node(instance in=w6) -> ("# of Small Floodgates"=w20, "Small Floodgates Size (cfs)"=w21, "Small Floodgates Status"=w22)
      s2 = $"Error in"  # shift register
      for (N = w20) (iteration -> i2) {
        Array Index(array=w22) -> (out0[i2]=w24)
        call "Init.gvi"(Size (cfs)=w21, State (FALSE = Closed)=w24, Error in=s2) -> (Floodgate out=w25, Error out=w26)
        append w25 to w23
        next s2 = w26
      }
      Property Node(instance in=w7) -> ("# of Turbines"=w27, "Power at Max Flow (MW)"=w28, "Turbine Gates Status"=w29, "Turbines State (%)"=w30)
      s3 = $"Error in"  # shift register
      for (N = w27) (iteration -> i3) {
        Array Index(array=w29) -> (out0[i3]=w32)
        Array Index(array=w30) -> (out0[i3]=w33)
        call "Init.gvi"(Power at Max Flow (MW)=w28, Gate State (FALSE = Closed)=w32, Open Percentage (%)=w33, Error in=s3) -> (Turbine out=w34, Error out=w35)
        append w34 to w31
        next s3 = w35
      }
      call "Open or Create.gvi"(Log Path=$"Log Path", Error in=$"Error in") -> (Report out=w36, Error out=w37)
      Merge Errors(w12, s1, s2, s3, w37) -> (error out=w38)
      Property Node(instance in="Dam.gtype" constant, "Report"=w36, "Lake"=w11, "Turbines"=w31, "Large floodgates"=w16, "Small floodgates"=w23, error in=w38) -> (error out=w2, instance out=w3)
    }
    frame Error {
      w2 = $"Error in"
      w3 = "Dam.gtype" constant
    }
  }
  $"Dam out" <- w3
  $"Error out" <- w2
