vi "Main.gvi"   [LabVIEW NXG 3.0.0]
panel controls:
  "Stop": bool
  "Settings": i32
  "Inflow (cfs)": f64 = 1000
  "Large Floodgates Status": bool[] = [FALSE, FALSE, FALSE, FALSE]
  "Small Floodgates Status": bool[] = [FALSE, FALSE, FALSE, FALSE]
  "Turbines Status": bool[] = [FALSE, TRUE, FALSE, FALSE]
  "Turbines Open Gap (%)": f64[] = [41.8597271091, 60.594530904]
  "Reset": bool
panel indicators:
  "Lake Fill (Acre-feet)": f64
  "Inflow (cfs) reading": f64
  "Total Power Generation (MW)": f64
  "Log Path": path
  "error out": error
uses:
  NI::G Core::Error::Build Error Cluster.gvi
  Dam.gtype::Close.gvi
  Dam.gtype::Update Dam.gvi
  Dam.gtype::Log Status.gvi
  NI::G Core::Error::Clear Error Cluster.gvi
  Dam.gtype::Init.gvi
  Dam.gtype::Set Lake Inflow.gvi
  Dam.gtype::Set Turbines Status.gvi
  NI::G Core::Error::Multiplex Errors.gvi
  NI::G Core::Error::Display Error.gvi
diagram:
  call "Open QMH.gvi"() -> (Message Queue=w1, Stop Event=w2, error out=w3)
  call "Send Message.gvi"(Queue in=w1, Command="Initialize", Data=FALSE, Input=w3) -> (Queue out=w4, Output=w5)
  Register For Events("Stop Event"=w2, error in=w5) -> (error out=w6, event registration refnum out=w7)
  s1 = w6  # shift register
  while {
    event (timeout = 50) (dynamic events = w7) {
      on "Stop" Value changed {
        call "Send Message.gvi"(Queue in=w4, Command="Stop", Data=s1, Input=s1) -> (Output=w9)
        # This case sends a stop to the dam
        # It DOES NOT stop the consumer loop
        w8 = default
      }
      on "Dynamic" Stop Event {
        # This case stops the consumer loop
        # We make sure this can only happen if the producer loop stops too
        Event Data() -> ("event data"=w8)
        w9 = s1
      }
      on Timeout {
        call "Update Dam and Log.gvi"(Message Queue In=w4, Dam Update Time=1, Log Time=60, Error Input=s1) -> (Error Output=w9)
        # This case is used to keep the dam updated
        # Configure here the timing in which we refresh the dam
        # and the timing in which we log.
        w8 = default
      }
      on "Reset" Value changed {
        call "Send Message.gvi"(Queue in=w4, Command="Initialize", Data=$Reset, Input=s1) -> (Output=w9)
        # This case sends a reset to the dam
        # It sets all values to the default data
        w8 = default
      }
      on "Inflow (cfs)" Value changed {
        call "Send Message.gvi"(Queue in=w4, Command="Change Inflow", Data=$"Inflow (cfs)", Input=s1) -> (Output=w9)
        # This case sends a new inflow to the dam
        w8 = default
      }
      on "Turbines Open Gap (%)" Value changed; "Turbines Status" Value changed {
        Build Cluster($"Turbines Status", $"Turbines Open Gap (%)") -> w10
        # This case sends a new turbine settings to the dam
        call "Send Message.gvi"(Queue in=w4, Command="ChangeTurbines Status", Data=w10, Input=s1) -> (Output=w9)
        w8 = default
      }
    }
    call "Error Check.gvi"(Message Queue In=w4, Error In=w9) -> (Message Queue Out=w11, Error Output=w12)
    next s1 = w12
    stop if w8
  }
  s2 = "Dam.gtype" constant  # shift register
  while {
    call "Read Message.gvi"(Message Queue In=w4, Error in=w6) -> (Message Queue Out=w13, Command=w14, Data=w15, Error out=w16)
    case (w14) {
      frame Default {
        # This case executes when an undefined command arrives
        Format Into String(initString="Unknown command received: ", errIn=w16, w14) -> (outString=w20, errOut=w21)
        call "Build Error Cluster.gvi"(error in=w21, code=5000, description=w20) -> (error out=w17)
        w18 = default
        w19 = s2
      }
      frame "Stop" {
        Variant To Data(error in (no error)=w16, type=w16, variant=w15) -> (data=w22, error out=w23)
        Generate User Event(error in=w23, event data=TRUE, user event=w2) -> (error out=w24)
        call "Close.gvi"(Dam in=s2, Error in=w24) -> (Error out=w25)
        # This case stops the dam and sends a stop command to the producer loop
        Merge Errors(w22, w25) -> (error out=w17)
        w18 = TRUE
        w19 = "Dam.gtype" constant
      }
      frame "Update Dam" {
        call "Update Dam.gvi"(Dam in=s2, Error in=w16) -> (Dam out=w19, Fill (Acre-feet)=w26, Power Generated (MW)=w27, Error out=w17)
        $"Lake Fill (Acre-feet)" <- w26
        # This case should be run every second to make sure the dam updates its levels every second.
        $"Total Power Generation (MW)" <- w27
        w18 = default
      }
      frame "Log" {
        # This case asks the dam to log its state into its report
        call "Log Status.gvi"(Dam in=s2, Error in=w16) -> (Dam out=w19, Error out=w17)
        w18 = default
      }
      frame "Initialize" {
        Variant To Data(type=bool FALSE, variant=w15) -> (data=w28, error out=w29)
        call "Clear Error Cluster.gvi"(error in=w29)
        # This case initializes a new dam.
        # You can use it to reset it to its default values, too
        call "Init.gvi"(Reset?=w28, Error in=w16) -> (Dam out=w19, Log Path Out=w30, Error out=w17)
        $"Log Path" <- w30
        w18 = default
      }
      frame "Change Inflow" {
        Variant To Data(error in (no error)=w16, type=f64 0, variant=w15) -> (data=w31, error out=w32)
        call "Set Lake Inflow.gvi"(Dam in=s2, Intake Rate (cfs)=w31, Error in=w32) -> (Dam out=w19, Intake Rate out (cfs)=w33, Error out=w17)
        # Use this case to change the inflow rate of the dam
        $"Inflow (cfs) reading" <- w33
        w18 = default
      }
      frame "ChangeTurbines Status" {
        # Use this case to change the turbines status of the dam
        w34 = cluster{"Element 1": bool[], "Element 2": f64[]} {all zero or empty}
        Variant To Data(error in (no error)=w16, type=w34, variant=w15) -> (data=w35, error out=w36)
        Property Node(instance in=w35) -> ("Element 1"=w37, "Element 2"=w38)
        call "Set Turbines Status.gvi"(Dam in=s2, Turbines Status=w37, Turbine Gates=w38, Error in=w36) -> (Dam out=w19, Turbines Status Out=w39, Turbine Gates Out=w40, Error out=w17)
        $"Turbines Status" <- w39
        $"Turbines Open Gap (%)" <- w40
        w18 = default
      }
    }
    call "Error Check.gvi"(Message Queue In=w13, Error In=w17) -> (Error Output=w41)
    next s2 = w19
    stop if w18
  }
  call "Multiplex Errors.gvi"(error in 1=s1, error in 2=w41) -> (error out=w42)
  Unregister For Events(error in=w42, event registration refnum=w7) -> (error out=w43)
  call "Close QMH.gvi"(Message Queue=w11, Stop Event=w2, error in=w43) -> (error out=w44)
  $"error out" <- w44
  call "Display Error.gvi"(error in=w44)
